# Grasshopper definition FingerJoint_A[LaserCutting].gh (Grasshopper 0.9.76)
# plug-ins: Python Interpreter

int = Integer(10)
crv = Curve(<curve referenced from the Rhino model>)
int_2 = Integer(3)
int_3 = Integer(50)
bool = Boolean(False)
python = PythonScript(curve1=crv, degree=int_2, count=int_3, tangents=bool, divides=int, boolean=Toggle(False), material=Slider(1, range=0..2))  # -> out, curveJoin; inputs curve1: Curve, degree: Int32, count: Int32, tangents: Boolean, divides: Int32, boolean: Boolean
# ---------- python: Python ----------
import rhinoscriptsyntax as rs
import ghpythonlib.components as ghc
import math

curveRebuild=ghc.RebuildCurve(curve1,degree,count,tangents)

lengthCurve1=ghc.Length(curveRebuild)

lengthCurve1Div=ghc.Division(lengthCurve1,divides)

pattern=ghc.Division(lengthCurve1Div,2)
curve1DashPat=ghc.DashPattern(curveRebuild,pattern)
curveDash=ghc.ListItem(curve1DashPat,0,False)
curveGap=ghc.ListItem(curve1DashPat,1,False)

if (boolean==True):
    disp=-1.0
elif (boolean==False):
    disp=1.0 

materialThick=ghc.Multiplication(disp,material)

p0=ghc.ConstructPoint(1000,1000)
p1=ghc.ConstructPoint(-1000,1000)
p2=ghc.ConstructPoint(-1000,-1000)
p3=ghc.ConstructPoint(1000,-1000)
surface_1=ghc.x4PointSurface(p0,p1,p2,p3)

curveOffset=ghc.OffsetonSrf(curveDash,materialThick,surface_1)

curveDash_start=ghc.EndPoints(curveDash).start
curveDash_end=ghc.EndPoints(curveDash).end

curveOffset_start=ghc.EndPoints(curveOffset).start
curveOffset_end=ghc.EndPoints(curveOffset).end

curveCon_start=ghc.Line(curveDash_start,curveOffset_start)
curveCon_end=ghc.Line(curveDash_end,curveOffset_end)

curveAll_a=ghc.Merge(curveGap,curveCon_start)
curveAll_b=ghc.Merge(curveOffset,curveCon_end)

curveAll=ghc.Merge(curveAll_a,curveAll_b)
curveJoin=ghc.JoinCurves(curveAll,False)
# ---------- end python ----------
crv_2 = Curve(python.curveJoin)
