# Grasshopper definition End_Points.gh (Grasshopper 0.9.76)
# plug-ins: Python Interpreter

# End Points:
# Ο παρακάτω κώδικας δέχεται σαν είσοδο μια ανοιχτή καμπύλη και επιστρέφει ως σημεία τα άκρα της.
# Μεταβλητές εισόδου:
# curve – Καμπύλη
# Μεταβλητές εξόδου:
# StartPoint – Σημείο αρχής καμπύλης	  EndPoint – Σημείο τέλους καμπύλης
python = PythonScript()  # -> StartPoint, EndPoint; inputs curve: Curve
# ---------- python: Python ----------
import ghpythonlib.components as ghc

StartPoint = ghc.EndPoints(curve).start
EndPoint = ghc.EndPoints(curve).end
# ---------- end python ----------
