# Grasshopper definition Contour.gh (Grasshopper 0.9.76)
# plug-ins: Python Interpreter

# Contour:
# Ο παρακάτω κώδικας δέχεται ως είσοδο μια λίστα από καμπύλες, ένα σημείο, ένα διάνυσμα κατεύθυνσης και έναν αριθμό για την επιθυμητή απόσταση μεταξύ των ισοϋψών καμπύλων που δημιουργούνται με βάση αυτά τα στοιχεία.
# Μεταβλητές εισόδου:
# curve – Λίστα καμπύλων	  	point – Σημείο	  direction – Διάνυσμα κατεύθυνσης
# distance – Απόσταση μεταξύ ισοϋψών καμπύλων
# Μεταβλητές εξόδου:
# Contours – Ισοϋψείς καμπύλες	  	Parameters – Παράμετροι των ισοϋψών καμπύλων
python = PythonScript()  # -> Contours, Parameters; inputs curve: Curve, point: Point3d, direction: Vector3d
# ---------- python: Python ----------
import ghpythonlib.components as ghc

Contours = ghc.Contour(curve, point, direction, distance).contours
Parameters = ghc.Contour(curve, point, direction, distance).parameters
# ---------- end python ----------
