# Grasshopper definition Arc_From_Plane_Radius_Angle.gh (Grasshopper 0.9.76)
# plug-ins: Python Interpreter

pln = Plane(Plane(origin=(-15.94608222, -6.629732796, 0), x=(-0.6973963614, 0.716685646, 0), y=(0.7125053393, 0.6933285658, 0.1078500867)))
int = Integer(0)
# Arc (από επίπεδο, ακτίνα και γωνία):
# Ο παρακάτω κώδικας δημιουργεί ένα τόξο με δεδομένα το επίπεδο, την ακτίνα και τη γωνία. Το επίπεδο μπορεί να καθοριστεί μέσω του Grasshopper ή μέσω κώδικα. Η ακτίνα μπορεί να οριστεί από άλλα μέλη του Grasshopper (sliders, control knobs κλπ) ή να οριστεί από τον χρήστη μέσα στον κώδικα του. Παρομοίως το επίπεδο μπορεί να επιλεγεί μέσα από το περιβάλλον του Grasshopper ή να δημιουργηθεί μέσω κώδικα από το χρήστη (δες Params->Geometry->Plane).
# Μεταβλητές εισόδου:
# Plane – Επίπεδο	  	Radius – Ακτίνα  	Angle - Γωνία
# Μεταβλητές εξόδου:
# Arc – Τόξο που δημιουργείται
int_2 = Integer(1)
python = PythonScript(Plane=pln, Radius=int, Angle=int_2)  # -> Arc; inputs Plane: Plane
# ---------- python: Python ----------
import rhinoscriptsyntax as rs
import ghpythonlib.components as ghc

#Το Angle είναι σε ακτίνια
#Αν θέλαμε η είσοδος της γωνίας μας να είναι σε μοίρες,
#στην επόμενη γραμμή αντικαθιστούμε το Angle με Angle*0.0175

AngleDomain = ghc.ConstructDomain(0, Angle)
Arc = ghc.Arc(Plane, Radius, AngleDomain)
# ---------- end python ----------
