# Grasshopper definition Circle_From_3_Points.gh (Grasshopper 0.9.76)
# plug-ins: Python Interpreter

# Circle (από τρία σημεία):
# Ο παρακάτω κώδικας δημιουργεί ένα κύκλο με δεδομένα τρία σημεία. Τα σημεία μπορούν να επιλεγούν μέσα από το περιβάλλον του Grasshopper ή να δημιουργηθεί μέσω κώδικα από το χρήστη (δες Params->Geometry->Point).
# Μεταβλητές εισόδου:
# PointA – Σημείο Α	  	PointΒ – Σημείο Β		  PointC – Σημείο Γ
# Μεταβλητές εξόδου:
# Circle – Κύκλος που δημιουργείται μαζί με το επίπεδο και την ακτίνα του
python = PythonScript()  # -> Circle; inputs PointA: Point3d, PointB: Point3d, PointC: Point3d
# ---------- python: Python ----------
import ghpythonlib.components as ghc

Circle = ghc.Circle3Pt(PointA, PointB, PointC)
# ---------- end python ----------
