# Grasshopper definition Circle_From_Multiple_Points.gh (Grasshopper 0.9.76)
# plug-ins: Python Interpreter

# Circle (που να ικανοποιεί πλήθος σημείων):
# Ο παρακάτω κώδικας χρησιμοποιεί ως δεδομένο μια λίστα σημείων σύμφωνα με την οποία κατασκευάζει ένα κύκλο που περνά από τα σημεία αυτά.
# Μεταβλητές εισόδου:
# points – Λίστα σημείων
# Μεταβλητές εξόδου:
# Circle – Κύκλος που δημιουργείται
python = PythonScript()  # -> Circle; inputs points: list of Point3d
# ---------- python: Python ----------
import ghpythonlib.components as ghc

Circle = ghc.CircleFit(points)
# ---------- end python ----------
