# Grasshopper definition Circle_From_Radius_Plane.gh (Grasshopper 0.9.76)
# plug-ins: Python Interpreter

# Circle (από ακτίνα):
# Ο παρακάτω κώδικας δημιουργεί ένα κύκλο με δεδομένα την ακτίνα και το επίπεδο (plane). Η ακτίνα μπορεί να οριστεί από άλλα μέλη του Grasshopper (sliders, control knobs κλπ) ή να οριστούν από τον χρήστη μέσα στον κώδικα του. Παρομοίως το επίπεδο μπορεί να επιλεγεί μέσα από το περιβάλλον του Grasshopper ή να δημιουργηθεί μέσω κώδικα από το χρήστη (δες Params->Geometry->Plane). Σημείωση: αν δεν δοθεί επίπεδο θεωρείται πως είναι το επίπεδο xy.
# Μεταβλητές εισόδου:
# Plane – Επίπεδο	  	Radius – Ακτίνα
# Μεταβλητές εξόδου:
# Circle – Κύκλος που δημιουργείται
pln = Plane()
python = PythonScript(Plane=pln)  # -> Circle; inputs Plane: Plane
# ---------- python: Python ----------
import rhinoscriptsyntax as rs
import ghpythonlib.components as ghc

'''Αφαιρέστε το # από τις παρακάτω γραμμές για να προκαθορίσετε τη τιμή της ακτίνας'''

#Radius = 1

Circle = ghc.Circle(Plane, Radius)
# ---------- end python ----------
