# Grasshopper definition Circle_Tangent_to_2_Geometries.gh (Grasshopper 0.9.76)
# plug-ins: Python Interpreter

crv = Curve(<curve referenced from the Rhino model>)
crv_2 = Curve(<curve referenced from the Rhino model>)
# Circle (που εφάπτεται σε δύο καμπύλες):
# Ο παρακάτω κώδικας δημιουργεί ένα κύκλο που εφάπτεται σε δύο καμπύλες. Οι καμπύλες μπορούν να οριστούν μέσω του Grasshopper ή να δημιουργηθούν μέσω κώδικα από το χρήστη.
# Μεταβλητές εισόδου:
# CurveA – Καμπύλη Α	 CurveB – Καμπύλη Β 	 Center – Σημείο κέντρου κύκλου
# Μεταβλητές εξόδου:
# Circle – Κύκλος που δημιουργείται
# -Code needs fixing (No output?)-
pt = Point()
python = PythonScript(CurveA=crv, CurveB=crv_2, Center=pt)  # -> Circle; inputs CurveA: Curve, CurveB: Curve, Center: Point3d
# ---------- python: Python ----------
import ghpythonlib.components as ghc

'''Αφαιρέστε το # από τις παρακάτω γραμμές για να προκαθορίσετε τη τιμή του κέντρου'''

#Center = ghc.ConstructPoint(0,0,0)
Circle = ghc.CircleTanTan(CurveA, CurveB, Center)
# ---------- end python ----------
