# Grasshopper definition Circle_Tangent_to_3_Geometries.gh (Grasshopper 0.9.76)
# plug-ins: Python Interpreter

crv = Curve()
crv_2 = Curve()
crv_3 = Curve()
# Circle (που εφάπτεται σε τρείς καμπύλες):
# Ο παρακάτω κώδικας δημιουργεί ένα κύκλο που εφάπτεται σε τρείς καμπύλες. Οι καμπύλες μπορούν να οριστούν μέσω του Grasshopper ή να δημιουργηθούν μέσω κώδικα από το χρήστη. Το σημείο του κέντρου μπορεί να επιλεγεί μέσα από το περιβάλλον του Grasshopper ή να δημιουργηθεί μέσω κώδικα από το χρήστη (δες Params->Geometry->Point).
# Μεταβλητές εισόδου:
# CurveA – Καμπύλη Α	  CurveB – Καμπύλη Β 	  CurveC – Καμπύλη Γ
# Center – Σημείο κέντρου κύκλου
# Μεταβλητές εξόδου:
# Circle – Κύκλος που δημιουργείται
# -Code needs testing-
pt = Point()
python = PythonScript(CurveA=crv, CurveB=crv_2, CurveC=crv_3, Center=pt)  # -> Circle; inputs CurveA: Curve, CurveB: Curve, CurveC: Curve, Center: Point3d
# ---------- python: Python ----------
import ghpythonlib.components as ghc

Circle = ghc.CircleTanTanTan(CurveA, CurveB, CurveC, Center)
# ---------- end python ----------
