# Grasshopper definition Explode.gh (Grasshopper 0.9.76)
# plug-ins: Python Interpreter

# Explode:
# Ο παρακάτω κώδικας δέχεται σαν είσοδο μια καμπύλη και μια μεταβλητή τύπου bool που ρυθμίζει αν θα «σπάζει» η καμπύλη επανειλημμένα. Σαν έξοδο ο κώδικας αυτός έχει τα κομμάτια και τα σημεία όπου σπάει η καμπύλη.
# Μεταβλητές εισόδου:
# curve – Καμπύλη
# recursive – Μεταβλητή που ρυθμίζει αν η καμπύλη θα σπάζει επανειλημμένα
# Μεταβλητές εξόδου:
# Segments – Τα κομμάτια στα οποία σπάει η καμπύλη
# Vertices – Τα σημεία όπου σπάει η καμπύλη
python = PythonScript()  # -> Segments, Vertices; inputs curve: Curve, recursive: Boolean
# ---------- python: Python ----------
import ghpythonlib.components as ghc

'''Αντικαταστήστε το recursive πιο κάτω για να προκαθορίσετε τη τιμή του'''

Segments = ghc.Explode(curve, recursive).segments
Vertices = ghc.Explode(curve, recursive).vertices
# ---------- end python ----------
