# Grasshopper definition Join_Curves.gh (Grasshopper 0.9.76)
# plug-ins: Python Interpreter

# Join Curves:
# Ο παρακάτω κώδικας δέχεται σαν είσοδο μια λίστα από καμπύλες και μια μεταβλητή τύπου bool που ρυθμίζει αν η νέα καμπύλη, που θα προκύψει από την ένωση των καμπύλων της λίστας, θα διατηρήσει την φορά των καμπυλών που ενώθηκαν. Σαν έξοδο ο κώδικας αυτός έχει την καμπύλη που προέκυψε από την ένωση των καμπυλών της λίστας αλλά και τις καμπύλες που δεν ήταν δυνατόν να ενωθούν.
# Μεταβλητές εισόδου:
# curves – Λίστα καμπυλών προς ένωση
# keepDirectoin – Μεταβλητή που ρυθμίζει αν νέα καμπύλη θα διατηρήσει τη φορά των αρχικών
# Μεταβλητές εξόδου:
# CurvesJoined – Λίστα που περιέχει τη καμπύλη της ένωσης αλλά και τις καμπύλες που δεν ήταν δυνατόν να ενωθούν
python = PythonScript()  # -> CurvesJoined; inputs curvesIn: list of Curve, keepDirection: Boolean
# ---------- python: Python ----------
import ghpythonlib.components as ghc

'''Αντικαταστήστε το keepDirection πιο κάτω για να προκαθορίσετε τη τιμή του'''

CurvesJoined = ghc.JoinCurves(curvesIn, keepDirection)
# ---------- end python ----------
