# Grasshopper definition Curve_Curve.gh (Grasshopper 0.9.76)
# plug-ins: Python Interpreter

# Curve | Curve:
# Ο παρακάτω κώδικας έχει ως είσοδο μια καμπύλη και μια ευθεία και δίνει σαν έξοδο τα σημεία τομής τους, τον αριθμό των σημείων τομής αλλά και τις αποστάσεις αυτών των σημείων από την αρχή της καμπύλης.
# Μεταβλητές εισόδου:
# curve – Καμπύλη	  	line – Ευθεία
# Μεταβλητές εξόδου:
# Points – Λίστα των σημείων τομής	  PointsNum – Αριθμός σημείων τομής
# Parameters – Λίστα αποστάσεων των σημείων τομής από αρχή της καμπύλης
python = PythonScript()  # -> Points, ParamsA, ParamsB; inputs curveA: Curve, curveB: Curve
# ---------- python: Python ----------
import ghpythonlib.components as ghc

Points = ghc.CurveXCurve(curveA, curveB).points
ParamsA = ghc.CurveXCurve(curveA, curveB)[1]
ParamsB = ghc.CurveXCurve(curveA, curveB)[2]
# ---------- end python ----------
