# Grasshopper definition Construct_Domain2_from_2_Pairs_of_Numbers.gh (Grasshopper 0.9.76)
# plug-ins: Python Interpreter

# Construct Domain2 (από 2 ζευγάρια αριθμών):
# Ο παρακάτω κώδικας δημιουργεί ένα δισδιάστατο πεδίο (domain) από δύο ζευγάρια αριθμών.
# Μεταβλητές εισόδου:
# pair1min – Ελάχιστος αριθμός 1ης διάστασης 		  pair1max – Μέγιστος 1ης διάστασης
# pair2min – Ελάχιστος αριθμός 2ης διάστασης 		  pair2max – Μέγιστος 2ης διάστασης
# Μεταβλητές εξόδου:
# Domain – Τομέας που δημιουργείται
python = PythonScript()  # -> Domain
# ---------- python: Python ----------
import ghpythonlib.components as ghc

'''Αλλάξτε τα pair1min, pair1max, pair2min, pair2max πιο κάτω για να προκαθορίσετε τις τιμές τους'''

Domain = ghc.ConstructDomain2(pair1min, pair1max, pair2min, pair2max)
# ---------- end python ----------
