# Grasshopper definition Construct_Domain_from_2_Numbers.gh (Grasshopper 0.9.76)
# plug-ins: Python Interpreter

# Construct Domain (από 2 αριθμούς):
# Ο παρακάτω κώδικας δημιουργεί ένα τομέα (domain) από δύο αριθμούς.
# Μεταβλητές εισόδου:
# number1 – Πρώτος αριθμός  	number2 – Δεύτερος αριθμός
# Μεταβλητές εξόδου:
# Domain – Τομέας που δημιουργείται
python = PythonScript()  # -> Domain
# ---------- python: Python ----------
import ghpythonlib.components as ghc

#Αλλάξτε τα number1, number2 πιο κάτω για να προκαθορίσετε τις τιμές τους

Domain = ghc.ConstructDomain(number1, number2)
# ---------- end python ----------
