# Grasshopper definition Cull_Pattern.gh (Grasshopper 0.9.76)
# plug-ins: Python Interpreter

# Cull Pattern:
# Ο παρακάτω κώδικας δέχεται μια λίστα και ένα μοτίβο σύμφωνα με το οποίο αφαιρεί στοιχεία από τη λίστα και δίνει τη νέα λίστα που προκύπτει σαν έξοδο.
# Μεταβλητές εισόδου:
# listIn– Λίστα εισόδου	  	pattern – Το μοτίβο
# Μεταβλητές εξόδου:
# listOut – Λίστα εξόδου
# import ghpythonlib.components as ghc
# 
# ListOut = ghc.CullPattern(listIn, pattern)
python = PythonScript()  # -> ListOut; inputs listIn: list, pattern: list
# ---------- python: Python ----------
import ghpythonlib.components as ghc

ListOut = ghc.CullPattern(listIn, pattern)
# ---------- end python ----------
