# Grasshopper definition Sequence.gh (Grasshopper 0.9.76)
# plug-ins: Python Interpreter

# Sequence:
# Ο παρακάτω κώδικας δέχεται σαν είσοδο ένα σετ χαρακτήρων, το επιθυμητό μήκος και προαιρετικά παραμέτρους για τη μορφοποίηση που θέλουμε να έχει η ακολουθία της εξόδου.
# Μεταβλητές εισόδου:
# length – Μήκος ακολουθίας	  characters – Λίστα χαρακτήρων
# format – Παράμετροι μορφοποίησης
# Μεταβλητές εξόδου:
# SequenceOut – Ακολουθία
python = PythonScript()  # -> SequenceOut
# ---------- python: Python ----------
import ghpythonlib.components as ghc

SequenceOut = ghc.Sequence(length, characters, format)
# ---------- end python ----------
