# Grasshopper definition Series.gh (Grasshopper 0.9.76)
# plug-ins: Python Interpreter

# Series:
# Ο παρακάτω κώδικας δημιουργεί μια αριθμητική σειρά με βάση έναν αρχικό αριθμό, το βήμα και το μήκος της επιθυμητής σειράς.
# Μεταβλητές εισόδου:
# start – Αρχή σειράς		  step – Βήμα σειράς		  length – Μήκος σειράς
# Μεταβλητές εξόδου:
# SeriesOut – Σειρά που δημιουργείται
python = PythonScript()  # -> SeriesOut; inputs length: Int32
# ---------- python: Python ----------
import ghpythonlib.components as ghc

'''Αντικαταστήστε τα start, step και length για να προκαθορίσετε τις τιμές τους'''

SeriesOut = ghc.Series(start, step, length)
# ---------- end python ----------
