# Grasshopper definition Deconstruct_Brep.gh (Grasshopper 0.9.76)
# plug-ins: Python Interpreter

# Deconstruct Brep:
# Ο παρακάτω κώδικας δέχεται σαν είσοδο ένα στερεό (BREP) και σαν έξοδο δίνει σαν λίστες τις έδρες, τις ακμές και τις κορυφές του.
# Μεταβλητές εισόδου:
# brep - Στερεό
# Μεταβλητές εξόδου:
# Faces – Έδρες	  Edges – Ακμές	  Vertices - Κορυφές
python = PythonScript()  # -> Faces, Edges, Vertices; inputs brep: Brep
# ---------- python: Python ----------
import ghpythonlib.components as ghc

Faces = ghc.DeconstructBrep(brep).faces
Edges = ghc.DeconstructBrep(brep).edges
Vertices = ghc.DeconstructBrep(brep).vertices
# ---------- end python ----------
