# Grasshopper definition Volume.gh (Grasshopper 0.9.76)
# plug-ins: Python Interpreter

# Volume:
# Ο παρακάτω κώδικας δημιουργεί δέχεται σαν είσοδο ένα στερεό (BREP) και σαν έξοδο δίνει τον όγκο και το κέντρο μάζας του.
# Μεταβλητές εισόδου:
# brep - Στερεό
# Μεταβλητές εξόδου:
# Volume – Όγκος στερεού	  	Centroid – Κέντρο μάζας στερεού
python = PythonScript()  # -> Volume, Centroid; inputs brep: Brep
# ---------- python: Python ----------
import ghpythonlib.components as ghc

Volume = ghc.Volume(brep).volume
Centroid = ghc.Volume(brep).centroid
# ---------- end python ----------
