# Grasshopper definition 4Point_Surface.gh (Grasshopper 0.9.76)
# plug-ins: Python Interpreter

# Edge Surface:
# Ο παρακάτω κώδικας δέχεται σαν είσοδο τέσσερα σημεία και σαν έξοδο δίνει μια επιφάνεια. Τα σημεία μπορούν να επιλεγούν μέσα από το περιβάλλον του Grasshopper ή να δημιουργηθεί μέσω κώδικα από το χρήστη (δες Params->Geometry->Point).
# Μεταβλητές εισόδου:
# pointA, pointB, pointC, pointD – Σημεία-άκρα επιφάνειας
# Μεταβλητές εξόδου:
# Surface – Επιφάνεια
python = PythonScript()  # -> Surface; inputs pointA: Point3d, pointB: Point3d, pointC: Point3d, pointD: Point3d
# ---------- python: Python ----------
import ghpythonlib.components as ghc

pointList = [pointA, pointB, pointD, pointC]
Surface = ghc.SurfaceFromPoints(pointList, 2, False)
# ---------- end python ----------
