# Grasshopper definition Edge_Surface.gh (Grasshopper 0.9.76)
# plug-ins: Python Interpreter

# Edge Surface:
# Ο παρακάτω κώδικας δέχεται σαν είσοδο από δύο εώς τέσσερις καμπύλες και με βάση αυτές δημιουργεί μια επιφάνεια που δίνει σαν έξοδο.
# Μεταβλητές εισόδου:
# curveA, curveB, curveC, curveD – Καμπύλες εισόδου
# Μεταβλητές εξόδου:
# Surface – Επιφάνεια
python = PythonScript()  # -> Surface; inputs curveA: Curve, curveB: Curve, curveC: Curve, curveD: Curve
# ---------- python: Python ----------
import ghpythonlib.components as ghc

Surface = ghc.EdgeSurface(curveA, curveB, curveC, curveD)
# ---------- end python ----------
