# Grasshopper definition Isotrim.gh (Grasshopper 0.9.76)
# plug-ins: Python Interpreter

# Isotrim:
# Ο παρακάτω κώδικας δέχεται σαν είσοδο μια επιφάνεια και ένα πεδίο και σαν έξοδο δίνει ένα ισοπαραμετρικό υποσύνολο της επιφάνειας.
# Μεταβλητές εισόδου:
# surfaceIn - Επιφάνεια	  domain - Πεδίο
# Μεταβλητές εξόδου:
# SurfaceOut – Ισοπαραμετρικό υποσύνολο επιφάνειας
python = PythonScript()  # -> SurfaceOut; inputs surfaceIn: Surface, domain: Surface
# ---------- python: Python ----------
import ghpythonlib.components as ghc

SurfaceOut = ghc.Isotrim(surfaceIn, domain)
# ---------- end python ----------
