# Grasshopper definition Box_Morph.gh (Grasshopper 0.9.76)
# plug-ins: Python Interpreter

# Box Morph:
# Ο παρακάτω κώδικας δέχεται σαν είσοδο ένα γεωμετρικό στοιχείο, και δύο κουτιά (ένα αναφοράς και ένα ως στόχος). Με αυτά τα δεδομένα ο κώδικας μορφοποιεί το γεωμετρικό στοιχείο σε κουτί το οποίο δίνει σαν έξοδο.
# Μεταβλητές εισόδου:
# geometryIn – Γεωμετρικό στοιχείο	  reference, target – Κουτιά αναφοράς κα στόχου
# Μεταβλητές εξόδου:
# GeometryOut – Κουτί στην έξοδο
python = PythonScript()  # -> GeometryOut; inputs reference: Box, target: Box
# ---------- python: Python ----------
import ghpythonlib.components as ghc

GeometryOut = ghc.BoxMorph(geometryIn, reference, target)
# ---------- end python ----------
