# Grasshopper definition Rectangular.gh (Grasshopper 0.9.76)
# plug-ins: Python Interpreter

# Rectangular:
# Ο παρακάτω κώδικας δημιουργεί ένα ορθογώνιο πλέγμα χρησιμοποιώντας ένα επίπεδο, το επιθυμητό μήκος στον x και y άξονα και το πόσα κελιά επιθυμεί ο χρήστης να έχει σε κάθε άξονα. Οι παράμετροι sizeX, sizeY, cellsX, cellsY μπορούν να οριστούν από άλλα μέλη του Grasshopper (sliders, control knobs κλπ) ή να οριστούν από τον χρήστη μέσα στον κώδικα του.
# Μεταβλητές εισόδου:
# sizeX – Μήκος στο x άξονα	  	sizeY – Μήκος στον y άξονα
# cellsX – Αριθμός κελίων στον x άξονα	  cellsY – Αριθμός κελιών στον y άξονα
# plane – Επίπεδο
# Μεταβλητές εξόδου:
# Cells – Λίστα των κελιών του πλέγματος	  	Points – Λίστα των σημείων του πλέγματος
python = PythonScript()  # -> Cells, Points; inputs plane: Plane
# ---------- python: Python ----------
import ghpythonlib.components as ghc

'''Αντικαταστήστε τα sizeX, sizeY, cellsX, cellsY αν επιθυμείτε να προκαθορίσετε τις τιμές τους'''

Cells = ghc.Rectangular(plane, sizeX, sizeY, cellsX, cellsY).cells
Points = ghc.Rectangular(plane, sizeX, sizeY, cellsX, cellsY).points
# ---------- end python ----------
