# Grasshopper definition Distance.gh (Grasshopper 0.9.76)
# plug-ins: Python Interpreter

# Distance:
# Ο παρακάτω κώδικας δέχεται σαν είσοδο δύο σημεία στο χώρο και υπολογίζει τη μεταξύ τους απόσταση. Τα σημεία μπορούν να οριστούν μέσα από το περιβάλλον του Grasshopper ή από τον κώδικα του χρήστη (δες Vector -> Point -> Construct Point).
# Μεταβλητές εισόδου:
# pointA – Πρώτο σημείο	  	pointB – Δεύτερο σημείο
# Μεταβλητές εξόδου:
# DistanceOut – Απόσταση σημείων
python = PythonScript()  # -> DistanceOut; inputs pointA: Point3d, pointB: Point3d
# ---------- python: Python ----------
import ghpythonlib.components as ghc

DistanceOut = ghc.Distance(pointA, pointB)
# ---------- end python ----------
