# Grasshopper definition Vector_From_2_Points.gh (Grasshopper 0.9.76)
# plug-ins: Python Interpreter

# Vector από 2 σημεία:
# Ο παρακάτω κώδικας δημιουργεί ένα διάνυσμα με παραμέτρους x, y, z από 2 σημεία. Τα δύο αυτά σημεία μπορούν να καθοριστούν είτε μέσα από το Grasshopper είτε να δημιουργηθούν από το χρήστη χρησιμοποιώντας τον κώδικα από το Params->Geometry->Point.
# Μεταβλητές εισόδου:
# ptA – Πρώτο σημείο	  	ptB – Δεύτερο σημείο
# Μεταβλητές εξόδου:
# Vector – Διάνυσμα που δημιουργείται
# VectorMagnitude – Μέτρο του διανύσματος
python = PythonScript()  # -> Vector, VectorMagnitude; inputs ptA: Point3d, ptB: Point3d
# ---------- python: Python ----------
import rhinoscriptsyntax as rs
import ghpythonlib.components as ghc

'''Αφαιρέστε το # από τις παρακάτω γραμμές για να προκαθορίσετε τις τιμές x,y,z'''

#ptA = ghc.ConstructPoint(x1,y1,z1)
#ptB = ghc.ConstructPoint(x2,y2,z2)

Vector = ghc.Vector2Pt(ptA, ptB).vector
VectorMagnitude = ghc.VectorLength(Vector)
# ---------- end python ----------
